# Dynamo graph DynamoWorkspace.dyn (Dynamo 0.8.0.950)

select_edge = DSEdgeSelection()  # 1 picked in the model
select_edge_2 = DSEdgeSelection()  # 1 picked in the model
number = DoubleInput(10)
morphedRebar = Rebar.MorphedRebar(select_edge, select_edge_2, number)
select_model_element = DSModelElementSelection()  # 1 picked in the model
id = Element.Id(select_model_element)
byCurve = Rebar.ByCurve(morphedRebar, id)
select_face = DSFaceSelection()  # 1 picked in the model
number_2 = DoubleInput(4)
boolean = BoolSelector(false)
followingSurface = Rebar.FollowingSurface(select_face, number_2, arg3=boolean)
byCurve_2 = Rebar.ByCurve(followingSurface, id)
select_face_2 = DSFaceSelection()  # 1 picked in the model
select_faces = SelectFaces()  # 3 picked in the model
flatten = Flatten(select_faces)
number_3 = DoubleInput(0.3)
number_4 = DoubleInput(10)
perpendicularRebar = Rebar.PerpendicularRebar(select_face_2, flatten, number_3, number_4)
flatten_2 = Flatten(perpendicularRebar)
select_model_element_2 = DSModelElementSelection()  # 1 picked in the model
id_2 = Element.Id(select_model_element_2)
byCurve_3 = Rebar.ByCurve(flatten_2, id_2)
revitRebarHookType = RevitRebarHookType.RevitRebarHookType()
